# Grasshopper definition dev_big.ghx (Grasshopper 1.0.7)

# ---- group: Add Module Path
python = GhPythonScript(PATH="C:\Users\yoshioca\Documents\GH_Gcode")  # -> out, a
# ---------- python: Python ----------
import sys

sys.path.append(PATH)

print(sys.path)
# ---------- end python ----------

# ----
panel = Panel(python.out)
# - Viewer -
panel_2 = Panel("C:\Users\yoshioca\Documents\GH_Gcode\_data_\data_out\2020-05-02_01-18-43.gcode")
panel_3 = Panel("C:\Users\yoshioca\Documents\GH_Gcode\_data_\EB_Daihatsu_seal_ysok_fanuc.gcode")

# ---- group: Input Polyline
# Dev
# - Polyline to GCode -
crv = Curve([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])

# ---- group: M4 S
panel_4 = Panel("50")

# ---- group: M4 Stop Time (Sec)
panel_5 = Panel("0.4")

# ---- group: F
panel_6 = Panel("1800")

# ---- group: F (1st Layer)
panel_7 = Panel("1000")

# ---- group: 0.04 (M3 S = 0.04 * F)
panel_8 = Panel("0.04")

# ---- group: Z_OFFSET
panel_9 = Panel("5")

# ---- group: Z_Buffer (Travel)
panel_10 = Panel("2")

# ---- group: Export
button = Button()

# ---- group: Export Path
panel_11 = Panel("C:\Users\yoshioca\Documents\GH_Gcode\_data_\data_out\")

# ----
panel_12 = Panel("C:\Users\yoshioca\Documents\GH_Gcode\_data_\data_marlin\S_Bunny_275.gcode")
panel_13 = Panel("C:\Users\yoshioca\Documents\GH_Gcode\_data_\data_marlin\S_Bunny_275_short.gcode")
python_2 = GhPythonScript(F=panel_6, F_1st=panel_7, AMP=panel_8)  # -> M3, M3_1st
# ---------- python_2: Python ----------
M3 = int(float(F) * float(AMP))
M3_1st = int(float(F_1st) * float(AMP))
# ---------- end python_2 ----------
panel_14 = Panel(python_2.M3_1st)
panel_15 = Panel(python_2.M3)
preview = CustomPreview(
    Geometry=crv,
    Material={diffuse=RGB(221, 160, 221), emission=RGB(66, 48, 66), shine=0.5, specular=RGB(255, 255, 255), transparency=0})
python_3 = GhPythonScript(PATH=panel_3)  # -> out, MOVE
# ---------- python_3: Python ----------
import rhinoscriptsyntax as rs

from gh_gcode import viewer_big, util

ut = util.Util()
vb = viewer_big.ViewerBig()

reload(util)
reload(viewer_big)


###


xyzs = vb.gcode_to_array(PATH)

#print(xyzs)
points_ = vb.draw_path(xyzs) 
MOVE = rs.AddPolyline(points_)
# ---------- end python_3 ----------
python_4 = GhPythonScript()  # -> out, a
# ---------- python_4: Python ----------
s = "G1 X0\n"
s_s = s.split("\n")

print(s)
print(s_s)
# ---------- end python_4 ----------
python_5 = GhPythonScript(
    POLYLINES=crv,
    M4_S_VALUE=panel_4,
    M4_STOP_TIME=panel_5,
    F_VALUE=panel_6,
    F_VALUE_1st=panel_7,
    M3_S_VALUE=panel_15,
    M3_S_VALUE_1st=panel_14,
    Z_OFFSET_VALUE=panel_9,
    Z_BUFFER=panel_10,
    EXPORT=button,
    EXPORT_DIR=panel_11)  # -> out, POINTS, DEV; inputs POLYLINES: list
# ---------- python_5: Python ----------
import rhinoscriptsyntax as rs


from gh_gcode import operate_curve, operate_big_gcode, util

gc = operate_curve.Curve()
gg = operate_big_gcode.BigGcode()
ut = util.Util()

reload(operate_curve)
reload(operate_big_gcode)
reload(util)


##########



##########



### Polylines to Points
pts = gc.polylines_to_points(POLYLINES)
POINTS = ut.flatten_runtime_list(pts)


### Z OFFSET
pts_off = gc.offset_z(pts, Z_OFFSET_VALUE)
DEV = ut.flatten_runtime_list(pts_off)


### Points to Gcode
gcode = gg.points_list_to_gcode(pts_off, M3_S_VALUE, M3_S_VALUE_1st, M4_S_VALUE, F_VALUE, F_VALUE_1st, Z_OFFSET_VALUE, M4_STOP_TIME, Z_BUFFER)



if EXPORT == True:
    ut.export_gcode(EXPORT_DIR, gcode)
# ---------- end python_5 ----------
python_6 = GhPythonScript(PATH=panel_12)  # -> out, MOVE, a
# ---------- python_6: Python ----------
import rhinoscriptsyntax as rs

from gh_gcode import viewer_marlin

vm = viewer_marlin.ViewerMarlin()
reload(viewer_marlin)

###


xyz = vm.gcode_to_array(PATH)
#points_ = vv.draw_path(xyz)


for i in xrange(0, 100):
    amp = 0
    print(xyz[i + amp])


MOVE = rs.AddPolyline(xyz)
# ---------- end python_6 ----------
lng = ListLength(List=python_6.out)
panel_16 = Panel(python_3.out)
panel_17 = Panel(lng)
panel_18 = Panel(python_6.MOVE)
pline = PolyLine(Vertices=python_5.DEV, Closed=False)  # disabled
panel_19 = Panel(python_5.out)
pt = Point(python_5.POINTS)
panel_20 = Panel("C:\Users\yoshioca\Documents\GH_Gcode\_data_\data_out\")

# ---- group: Draw Sequence
divide = DivideCurve(Curve=python_3.MOVE, Count=1000, Kinks=False)  # -> Points, Tangents, Parameters
item = ListItem(List=divide.Points, Index=Slider(470, range=0..1000), Wrap=True)
sph = Sphere(Base=item, Radius=5)

divide_2 = DivideCurve(Curve=python_6.MOVE, Count=1000, Kinks=False)  # -> Points, Tangents, Parameters
item_2 = ListItem(List=divide_2.Points, Index=Slider(470, range=0..1000), Wrap=True)
sph_2 = Sphere(Base=item_2, Radius=5)

# ---- group: Build Plate
swatch = ColourSwatch(SwatchColor=RGB(187, 255, 255))  # disabled
python_7 = GhPythonScript()  # -> out, AREA; disabled
# ---------- python_7: Python ----------
import rhinoscriptsyntax as rs

AREA = rs.AddRectangle(rs.WorldXYPlane(), 1700, 1300)
# ---------- end python_7 ----------
preview_2 = CustomPreview(Geometry=python_7.AREA, Material=swatch)  # disabled

swatch_2 = ColourSwatch(SwatchColor=RGB(187, 255, 255))  # disabled
python_8 = GhPythonScript()  # -> out, AREA; disabled; same code as python_7
preview_3 = CustomPreview(Geometry=python_8.AREA, Material=swatch_2)  # disabled
