# Grasshopper definition big_200427.ghx (Grasshopper 1.0.7)

# ---- group: Input Polyline
# Release : 200427
# - Polyline to GCode -
crv = Curve([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])

# ---- group: M3 S = 0.04 * F
panel = Panel("0.04")

# ---- group: M4 S
panel_2 = Panel("50")

# ---- group: F
panel_3 = Panel("1800")

# ---- group: Export
button = Button()

# ---- group: Export Path
panel_4 = Panel("C:\Users\yoshioca\Documents\GH_Gcode\_data_\data_out\")

# ----
# - Viewer -
panel_5 = Panel("C:\Users\yoshioca\Documents\GH_Gcode\_data_\data_out\2020-04-27_06-00-31.txt")
python = GhPythonScript(AMP=panel, F=panel_3)  # -> M3
# ---------- python: Python ----------
M3 = int(float(F) * float(AMP))
# ---------- end python ----------
panel_6 = Panel(python)
preview = CustomPreview(
    Geometry=crv,
    Material={diffuse=RGB(221, 160, 221), emission=RGB(66, 48, 66), shine=0.5, specular=RGB(255, 255, 255), transparency=0})
python_2 = GhPythonScript(PATH=panel_5)  # -> out, MOVE
# ---------- python_2: Python ----------
import rhinoscriptsyntax as rs


##################################
###    module for Grasshopper    #
###    Python 2                  #
##################################


class Gcode_for_GH():
    
    
    def open_file(self, path):
        with open(path) as f:
            l = f.readlines()
        # print(type(l))
        # print(len(l))
        # print(l)
        return l
    

    def add_xyz_to_polyline(self, path):

        gcode = self.open_file(path)

        count = 0
        x = []
        y = []
        z = []

        ### init
        x.append(0)
        y.append(0)
        z.append(0)

        # loop = 20
        loop = len(gcode)

        for i in range(loop):

            count += 1
            str_ = gcode[i]
            
            if ("X" in str_):
                ### Split Elements
                elements = str_.split()
                for j in range(len(elements)):
                    e = elements[j]
                    
                    if ("X" in e):
                        tmp_x = e.split("X")
                        x.append(tmp_x[1])
            else:
                tmp_x = x[i]
                x.append(tmp_x)


        for ii in range(loop):

            str_ = gcode[ii]
            
            if ("Y" in str_):
                ### Split Elements
                elements = str_.split()
                for jj in range(len(elements)):
                    e = elements[jj]
                    
                    if ("Y" in e):
                        tmp_y = e.split("Y")
                        y.append(tmp_y[1])
            else:
                tmp_y = y[ii]
                y.append(tmp_y)


        for iii in range(loop):

            str_ = gcode[iii]
            
            if ("Z" in str_):
                ### Split Elements
                elements = str_.split()
                for jjj in range(len(elements)):
                    e = elements[jjj]
                    
                    if ("Z" in e):
                        tmp_z = e.split("Z")
                        z.append(tmp_z[1])
            else:
                tmp_z = z[iii]
                z.append(tmp_z)

        # print("x : {} / {}".format(len(x), x))
        # print("y : {} / {}".format(len(y), y))
        # print("z : {} / {}".format(len(z), z))

        print("Count : {}".format(count))
        
        return x, y, z
    
    
    def zip_matrix(self, mat):
        ### https://note.nkmk.me/python-list-transpose/
        return [list(x) for x in zip(*mat)]



###################################


gg = Gcode_for_GH()


v = gg.add_xyz_to_polyline(PATH)
v_f = gg.zip_matrix(v)

print(len(v_f))
#print(v_f)



MOVE = rs.AddPolyline(v_f)
# ---------- end python_2 ----------
python_3 = GhPythonScript(POLYLINES=crv, M3_S_VALUE=panel_6, M4_S_VALUE=panel_2, F_VALUE=panel_3, EXPORT=button, EXPORT_DIR=panel_4)  # -> out, POINTS; inputs POLYLINES: list
# ---------- python_3: Python ----------
import datetime
import math
import rhinoscriptsyntax as rs


class Util():

    def get_current_time(self):
        return str(datetime.datetime.now().strftime("%Y-%m-%d_%H-%M-%S"))

    def remap_number(self, src, old_min, old_max, new_min, new_max):
        return ((src - old_min) / (old_max - old_min) * (new_max - new_min) + new_min)

    def flatten_runtime_list(self, list):
        all = []
        
        for i in xrange(len(list)):
            # print(i)
            sub = list[i]
            for j in xrange(len(sub)):
                # print(j)
                all.append(sub[j])

        return all

    def export_gcode(self, dir_path, txt):

        now = self.get_current_time()
        file_path = dir_path + now + ".txt"

        ### Export
        with open(file_path, 'w') as f:
            f.write(txt)

        print("Export GCode : {}".format(file_path))

ut = Util()



class Curve():

    def polyline_to_points(self, polyline):

        points = []

        ### Start Point
        start_pt = rs.CurveStartPoint(polyline)
        points.append(start_pt)


        ### Segment Points / Style : 4 = G1
        segments = rs.CurveDiscontinuity(polyline, 4)
        for j in range(len(segments)):
            points.append(segments[j])

        ### End Point
        end_pt =  rs.CurveEndPoint(polyline)
        points.append(end_pt)
        
        return points
    
    def polylines_to_points(self, polylines):

        points_array = []

        for i in xrange(len(polylines)):

            points = self.polyline_to_points(polylines[i])
            points_array.append(points)

        return points_array

gc = Curve()


class Gcode():

    def gcode_start(self):
        return "( == gcode start == )\n%\nG90\nG54\n( == gcode start == )\n( = )\n"


    def gcode_end(self):
        return "( == gcode end == )\nS0\nM5\nG1 Z50.0\nM30\n%\n( == gcode end == )\n"

    def define_print_info(self):
        now = ut.get_current_time()
        return "( = Polyline to Gcode by Grasshopper = )\n( = For EB 3D Printer = )\n( = Export : {} = )\n( = )\n".format(now)

    def define_extrude_filament(self, parge_value):
        return "( ==== Start Printing ==== )\n( == Extrude Filament == )\nM3 S{} P1\n".format(parge_value)

    def define_stop_filament(self, reverse_value):
        return "( == Stop Filament == )\nM4 S{} P1\n".format(reverse_value)

    def define_travel(self, current_z):
        ### buffer (mm)
        Z_BUFFER = float(25)
        new_z = str(float(current_z) + Z_BUFFER)
        return ("( == Travel == )\nG1 Z{}\n( = )\n".format(new_z))

    def points_to_gcode(self,points, m3_s, m4_s, f):

        txt = []

        ### Printing
        for i in xrange(len(points)):
            _px, _py, _pz = points[i]
            px = str("{:f}".format(_px))
            py = str("{:f}".format(_py))
            pz = str("{:f}".format(_pz))

            txt.append("G1 X{} Y{} Z{} F{}\n".format(px, py, pz, f))

            ### Extrude Filament
            if i == 0:
                ### M3
                txt.append(self.define_extrude_filament(m3_s))

            ### get current z
            if i == (len(points) - 1):
                _cx, _cy, _cz = points[i]
                cz = "{:f}".format(_cz)

        ### Printting Stop
        ### M4
        txt.append(self.define_stop_filament(m4_s))

        ### travel
        txt.append(self.define_travel(cz))

        txt_join = "".join(txt)

        return txt_join

    def points_list_to_gcode(self, points_list, m3_s, m4_s, f):
        
        export = []

        ### msg
        export.append(self.define_print_info())

        ### gcode start
        export.append(self.gcode_start())

        ### gcode
        for i in xrange(len(points_list)):
            
            pts = points_list[i]

            export.append("( ========= Layer : {} ========= )\n".format(i + 1))
            export.append(self.points_to_gcode(pts, m3_s, m4_s, f))
        
        ### gcode end
        export.append(self.gcode_end())

        export_join = "".join(export)

        return export_join

gg = Gcode()




####################




### Polylines to Points
pts = gc.polylines_to_points(POLYLINES)
POINTS = ut.flatten_runtime_list(pts)

### Points to Gcode
gcode = gg.points_list_to_gcode(pts, M3_S_VALUE, M4_S_VALUE, F_VALUE)



if EXPORT == True:
    ut.export_gcode(EXPORT_DIR, gcode)
# ---------- end python_3 ----------
panel_7 = Panel(python_3.out)
pt = Point(python_3.POINTS)

# ---- group: Draw Sequence
divide = DivideCurve(Curve=python_2.MOVE, Count=1000, Kinks=False)  # -> Points, Tangents, Parameters
item = ListItem(List=divide.Points, Index=Slider(1, range=0..1000), Wrap=True)
sph = Sphere(Base=item, Radius=5)

# ---- group: Build Plate
python_4 = GhPythonScript()  # -> out, AREA
# ---------- python_4: Python ----------
import rhinoscriptsyntax as rs

AREA = rs.AddRectangle(rs.WorldXYPlane(), 1700, 1300)
# ---------- end python_4 ----------
preview_2 = CustomPreview(Geometry=python_4.AREA, Material=ColourSwatch(SwatchColor=RGB(187, 255, 255)))
