# Grasshopper definition big_200502.ghx (Grasshopper 1.0.7)

# ---- group: Export
button = Button()

# ---- group: Export Path
panel = Panel("C:\Users\yoshioca\Documents\GH_Gcode\_data_\data_out\")

# ---- group: Input Polyline
# Release : 2020_05_02
# - Polyline to GCode -
crv = Curve([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])

# ---- group: S = 0.04 * F
panel_2 = Panel("0.04")

# ---- group: M4
panel_3 = Panel("50")

# ---- group: F
panel_4 = Panel("1800")

# ---- group: Z_OFFSET
panel_5 = Panel("5")

# ---- group: M4 Stop Time (Sec)
panel_6 = Panel("0.4")

# ---- group: Z_Buffer (Travel)
panel_7 = Panel("2")

# ----
# - Viewer -
# G4 X[value] << BUG
panel_8 = Panel("C:\Users\yoshioca\Documents\GH_Gcode\_data_\data_out\2020-04-28_20-36-18.txt")  # disabled
python = GhPythonScript(AMP=panel_2, F=panel_4)  # -> M3
# ---------- python: Python ----------
M3 = int(float(F) * float(AMP))
# ---------- end python ----------
panel_9 = Panel(python)
preview = CustomPreview(
    Geometry=crv,
    Material={diffuse=RGB(221, 160, 221), emission=RGB(66, 48, 66), shine=0.5, specular=RGB(255, 255, 255), transparency=0})
python_2 = GhPythonScript(
    POLYLINES=crv,
    M3_S_VALUE=panel_9,
    M4_S_VALUE=panel_3,
    F_VALUE=panel_4,
    Z_OFFSET_VALUE=panel_5,
    M4_STOP_TIME=panel_6,
    Z_BUFFER=panel_7,
    EXPORT=button,
    EXPORT_DIR=panel)  # -> out, POINTS, DEV; inputs POLYLINES: list
# ---------- python_2: Python ----------
import datetime
import math

import rhinoscriptsyntax as rs
import Rhino.Geometry as rg


class Util():


    def get_current_time(self):
        return str(datetime.datetime.now().strftime("%Y-%m-%d_%H-%M-%S"))


    def remap_number(self, src, old_min, old_max, new_min, new_max):
        return ((src - old_min) / (old_max - old_min) * (new_max - new_min) + new_min)


    def flatten_runtime_list(self, list):
        all = []
        
        for i in xrange(len(list)):
            # print(i)
            sub = list[i]
            for j in xrange(len(sub)):
                # print(j)
                all.append(sub[j])

        return all


    def export_gcode(self, dir_path, txt):

        now = self.get_current_time()
        file_path = dir_path + now + ".gcode"

        ### Export
        with open(file_path, 'w') as f:
            f.write(txt)

        print("Export GCode : {}".format(file_path))

ut = Util()


class Transform():


    def pt_pt_add(self, pt0, pt1):
        pt = [
            float(pt1[0]) + float(pt0[0]),
            float(pt1[1]) + float(pt0[1]),
            float(pt1[2]) + float(pt0[2])]
        return pt


    def pt_pt_subtract(self, pt0, pt1):
        pt = [
            float(pt0[0]) - float(pt1[0]),
            float(pt0[1]) - float(pt1[1]),
            float(pt0[2]) - float(pt1[2])]
        return pt


    def vector_multiplicate(self, vector, value):
        vec = [
            float(vector[0]) * value,
            float(vector[1]) * value,
            float(vector[2]) * value]
        return vec


    def vector_unitize(self, vector):
        length = math.sqrt(
            math.pow(float(vector[0]), 2) + 
            math.pow(float(vector[1]), 2) + 
            math.pow(float(vector[2]), 2))
        new_vector = self.vector_multiplicate(vector, (1.0 / length))
        return new_vector


    def move_pt_vec(self, pt, vec):
        p = [
            float(pt[0]) + float(vec[0]),
            float(pt[1]) + float(vec[1]),
            float(pt[2]) + float(vec[2])]
        return p

tr = Transform()


class Curve():


    def polyline_to_points(self, polyline):

        points = []

        ### Start Point
        start_pt = rs.CurveStartPoint(polyline)
        points.append(start_pt)

        ### Segment Points
        ### Style : 3 = C2 - Continuous first and second derivative
        segments = rs.CurveDiscontinuity(polyline, 3)
        for j in range(len(segments)):
            points.append(segments[j])

        ### End Point
        end_pt =  rs.CurveEndPoint(polyline)
        points.append(end_pt)
        
        return points


    def polylines_to_points(self, polylines):

        points_array = []

        for i in xrange(len(polylines)):

            points = self.polyline_to_points(polylines[i])
            points_array.append(points)

        return points_array


    def offset_z(self, points, z_offset_value):

        move_vec = [0, 0, z_offset_value]

        points_off = []

        for i in xrange(len(points)):
            sub = []
            tmp = points[i]
            for j in xrange(len(tmp)):
                pt = tmp[j]
                ### offset
                X, Y, Z = tr.move_pt_vec(pt, move_vec)
                pt_off = rg.Point3d(X, Y, Z)
                sub.append(pt_off)
            points_off.append(sub)
        
        return points_off

gc = Curve()


class BigGcode():


    def gcode_start(self):
        return "( == gcode start == )\n%\nG91\nG28 Z0.000\nG28 X0.000 Y0.000\nG49\nG80\nG90\nG54\n( == gcode start == )\n( --- )\n"


    def head_start(self):
        return "( === head1 start ===)\nM55\nM3 S0 P1\nM7\n( === head1 start ===)\n( - )\n"


    def gcode_end(self):
        return "( == gcode end == )\nM3 S0\nM5\nG91\nG28 Z0\nG28 X0 Y0\nM30\n%\n( == gcode end == )\n"


    def define_print_msg(self):
        return "( Polyline to Gcode by Grasshopper )\n( For EB 3D Printer )\n( --- )\n"


    def define_print_parameter(self, f, m3, m4, z_offset, stop_time, z_buffer):
        now = ut.get_current_time()
        return "( Export : {} )\n( F Value : {} )\n( M3 S Value: {} )\n( M4 S Value : {} )\n( M4 Stop Time : {} )\n( Z Offset Value : {} )\n( --- )\n".format(now, f, m3, m4, stop_time, z_offset)


    def define_extrude_filament(self, parge_value):
        return "( ==== Start Printing ==== )\n( == Extrude Filament == )\nM3 S{} P1\n".format(parge_value)


    def define_stop_filament(self, reverse_value, stop_time):
        return "( == Stop Filament == )\nM4 S{} P1\nG4 X{}\nM3 S0\n".format(reverse_value, stop_time)


    def define_travel(self, current_z, z_buffer):
        ### buffer (mm)
        Z_BUFFER = float(z_buffer)
        new_z = str(float(current_z) + Z_BUFFER)
        return ("( == Travel == )\nG1 Z{}\n( - )\n".format(new_z))


    def points_to_gcode(self,points, m3_s, m4_s, f, stop_time, z_buffer):

        txt = []

        ### Printing
        for i in xrange(len(points)):
            _px, _py, _pz = points[i]
            px = str("{:f}".format(_px))
            py = str("{:f}".format(_py))
            pz = str("{:f}".format(_pz))

            txt.append("G1 X{} Y{} Z{} F{}\n".format(px, py, pz, f))

            ### Extrude Filament
            if i == 0:
                ### M3
                txt.append(self.define_extrude_filament(m3_s))

            ### get current z
            if i == (len(points) - 1):
                _cx, _cy, _cz = points[i]
                cz = "{:f}".format(_cz)

        ### Printting Stop
        ### M4
        txt.append(self.define_stop_filament(m4_s, stop_time))

        ### travel
        txt.append(self.define_travel(cz, z_buffer))

        txt_join = "".join(txt)

        return txt_join


    def points_list_to_gcode(self, points_list, m3_s, m4_s, f, z_offset, stop_time, z_buffer):
        
        export = []

        ### print msg, print parameter
        export.append(self.define_print_msg())
        export.append(self.define_print_parameter(f, m3_s, m4_s, z_offset, stop_time, z_buffer))

        ### gcode start
        export.append(self.gcode_start())

        ### head start
        export.append(self.head_start())

        ### gcode
        for i in xrange(len(points_list)):
            
            pts = points_list[i]

            export.append("( ========= Layer : {} ========= )\n".format(i + 1))
            export.append(self.points_to_gcode(pts, m3_s, m4_s, f, stop_time, z_buffer))
        
        ### gcode end
        export.append(self.gcode_end())

        export_join = "".join(export)

        return export_join

gg = BigGcode()




##########



### Polylines to Points
pts = gc.polylines_to_points(POLYLINES)
POINTS = ut.flatten_runtime_list(pts)


### Z OFFSET
pts_off = gc.offset_z(pts, Z_OFFSET_VALUE)
DEV = ut.flatten_runtime_list(pts_off)


### Points to Gcode
gcode = gg.points_list_to_gcode(pts_off, M3_S_VALUE, M4_S_VALUE, F_VALUE, Z_OFFSET_VALUE, M4_STOP_TIME, Z_BUFFER)



if EXPORT == True:
    ut.export_gcode(EXPORT_DIR, gcode)
# ---------- end python_2 ----------
python_3 = GhPythonScript(PATH=panel_8)  # -> out, MOVE; disabled
# ---------- python_3: Python ----------
import rhinoscriptsyntax as rs


class Gcode_for_GH():
    
    def open_file(self, path):
        with open(path) as f:
            l = f.readlines()
        # print(type(l))
        # print(len(l))
        # print(l)
        return l
    
    def add_xyz_to_polyline(self, path):

        gcode = self.open_file(path)

        count = 0
        x = []
        y = []
        z = []

        ### init
        x.append(0)
        y.append(0)
        z.append(0)

        # loop = 20
        loop = len(gcode)

        for i in range(loop):

            count += 1
            str_ = gcode[i]
            
            if ("X" in str_):
                ### Split Elements
                elements = str_.split()
                for j in range(len(elements)):
                    e = elements[j]
                    
                    if ("X" in e):
                        tmp_x = e.split("X")
                        x.append(tmp_x[1])
            else:
                tmp_x = x[i]
                x.append(tmp_x)

        for ii in range(loop):

            str_ = gcode[ii]
            
            if ("Y" in str_):
                ### Split Elements
                elements = str_.split()
                for jj in range(len(elements)):
                    e = elements[jj]
                    
                    if ("Y" in e):
                        tmp_y = e.split("Y")
                        y.append(tmp_y[1])
            else:
                tmp_y = y[ii]
                y.append(tmp_y)

        for iii in range(loop):

            str_ = gcode[iii]
            
            if ("Z" in str_):
                ### Split Elements
                elements = str_.split()
                for jjj in range(len(elements)):
                    e = elements[jjj]
                    
                    if ("Z" in e):
                        tmp_z = e.split("Z")
                        z.append(tmp_z[1])
            else:
                tmp_z = z[iii]
                z.append(tmp_z)

        # print("x : {} / {}".format(len(x), x))
        # print("y : {} / {}".format(len(y), y))
        # print("z : {} / {}".format(len(z), z))

        print("Count : {}".format(count))
        
        return x, y, z
     
    def zip_matrix(self, mat):
        ### https://note.nkmk.me/python-list-transpose/
        return [list(x) for x in zip(*mat)]



###################################


gg = Gcode_for_GH()


v = gg.add_xyz_to_polyline(PATH)
v_f = gg.zip_matrix(v)

#print(len(v_f))
print(v_f)


def pl(p_list):
    pts = []
    for i in xrange(len(p_list)):
        item = p_list[i]
        new_item = []
        if j in xrange():
            print(item)


pl(v_f)
#MOVE = rs.AddPolyline(v_f)
# ---------- end python_3 ----------
number_slider = Slider(1, range=0..1000)  # disabled
pline = PolyLine(Vertices=python_2.DEV, Closed=False)  # disabled
panel_10 = Panel(python_2.out)
pt = Point(python_2.POINTS)
panel_11 = Panel("C:\Users\yoshioca\Documents\GH_Gcode\_data_\data_out\")

# ---- group: Draw Sequence
divide = DivideCurve(Curve=python_3.MOVE, Count=1000, Kinks=False)  # -> Points, Tangents, Parameters; disabled
item = ListItem(List=divide.Points, Index=number_slider, Wrap=True)  # disabled
sph = Sphere(Base=item, Radius=5)  # disabled

# ---- group: Build Plate
swatch = ColourSwatch(SwatchColor=RGB(187, 255, 255))  # disabled
python_4 = GhPythonScript()  # -> out, AREA; disabled
# ---------- python_4: Python ----------
import rhinoscriptsyntax as rs

AREA = rs.AddRectangle(rs.WorldXYPlane(), 1700, 1300)
# ---------- end python_4 ----------
preview_2 = CustomPreview(Geometry=python_4.AREA, Material=swatch)  # disabled

# ----
python_5 = GhPythonScript()  # -> out, a
# ---------- python_5: Python ----------
import rhinoscriptsyntax as rs
import Rhino.Geometry as rg

a = rg.Point3d(
# ---------- end python_5 ----------
