# Grasshopper definition big_200505.ghx (Grasshopper 1.0.7)

# - Viewer -
panel = Panel("C:\Users\yoshioca\Documents\GH_Gcode\_data_\data_out\2020-05-02_01-18-43.gcode")
panel_2 = Panel("C:\Users\yoshioca\Documents\GH_Gcode\_data_\EB_Daihatsu_seal_ysok_fanuc.gcode")

# ---- group: Input Polyline
# Release : 200505
# - Polyline to GCode -
crv = Curve([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])

# ---- group: M4 S
panel_3 = Panel("50")

# ---- group: M4 Stop Time (Sec)
panel_4 = Panel("0.4")

# ---- group: F
panel_5 = Panel("1800")

# ---- group: F (1st Layer)
panel_6 = Panel("1000")

# ---- group: 0.04 (M3 S = 0.04 * F)
panel_7 = Panel("0.04")

# ---- group: Z_OFFSET
panel_8 = Panel("5")

# ---- group: Z_Buffer (Travel)
panel_9 = Panel("2")

# ---- group: Export
button = Button()

# ---- group: Export Path
panel_10 = Panel("C:\Users\yoshioca\Documents\GH_Gcode\_data_\data_out\")

# ----
python = GhPythonScript(F=panel_5, F_1st=panel_6, AMP=panel_7)  # -> M3, M3_1st
# ---------- python: Python ----------
M3 = int(float(F) * float(AMP))
M3_1st = int(float(F_1st) * float(AMP))
# ---------- end python ----------
panel_11 = Panel(python.M3_1st)
panel_12 = Panel(python.M3)
preview = CustomPreview(
    Geometry=crv,
    Material={diffuse=RGB(221, 160, 221), emission=RGB(66, 48, 66), shine=0.5, specular=RGB(255, 255, 255), transparency=0})
python_2 = GhPythonScript(PATH=panel_2)  # -> out, MOVE
# ---------- python_2: Python ----------
import datetime
import math

import rhinoscriptsyntax as rs


class Util():


    def get_current_time(self):
        return str(datetime.datetime.now().strftime("%Y-%m-%d_%H-%M-%S"))


    def remap_number(self, src, old_min, old_max, new_min, new_max):
        return ((src - old_min) / (old_max - old_min) * (new_max - new_min) + new_min)


    def flatten_runtime_list(self, list):
        all = []
        
        for i in xrange(len(list)):
            # print(i)
            sub = list[i]
            for j in xrange(len(sub)):
                # print(j)
                all.append(sub[j])

        return all


    def export_gcode(self, dir_path, txt):

        now = self.get_current_time()
        file_path = dir_path + now + ".gcode"

        ### Export
        with open(file_path, 'w') as f:
            f.write(txt)

        print("Export GCode : {}".format(file_path))


    def zip_matrix(self, mat):
        ### https://note.nkmk.me/python-list-transpose/
        return [list(x) for x in zip(*mat)]


    def padding_previous_value(self, list_):
        
        list_pad = []

        for i in xrange(len(list_)):
            
            item_ = list_[i]

            ### First 
            if i == 0:
                if (item_ == None):
                    list_pad.append(0)
                else:
                    list_pad.append(item_)
            
            ### Not Frist
            else:
                if (item_ == None):
                    tmp = list_pad[i-1]
                    list_pad.append(tmp)
                else:
                    list_pad.append(item_)
        
        return list_pad


    def remove_previous_elements(self, a_list):

        ### Remove Same Element as the Previous One
        new_list = []
        src_length = len(a_list)

        for i in range(src_length):
            tmp = a_list[i]

            ### 
            if i < src_length-1:
                if a_list[i] != a_list[i+1]:
                    new_list.append(tmp)
            ### Last
            else:
                new_list.append(tmp)
                
        return new_list

ut = Util()


class ViewerBig():
    
    
    def open_file(self, path):
        with open(path) as f:
            l = f.readlines()
        # print(type(l))
        # print(len(l))
        # print(l)
        return l


    def get_value_g1(self, str_):
        
        ### Split Elements
        elements = str_.split()

        ### init
        xx = None
        yy = None
        zz = None
        
        for i in xrange(len(elements)):
            elm = elements[i]

            ### Get Value
            if ("X" in elm):
                tmp_x = elm.split("X")
                xx = float(tmp_x[1])
            
            elif ("Y" in elm):
                tmp_y = elm.split("Y")
                yy = float(tmp_y[1])
            
            elif ("Z" in elm):
                tmp_z = elm.split("Z")
                zz = float(tmp_z[1])

        return [xx, yy, zz, None]


    def get_value_g28(self, str_):
        
        ### G28 = Machine Origin
        mo_x, mo_y, mo_z = [0, 0, 1300]

        ### Split Elements
        elements = str_.split()

        ### init
        xx = None
        yy = None
        zz = None

        for i in xrange(len(elements)):
            elm = elements[i]

            ### Get Value
            if ("X" in elm):
                tmp_x = elm.split("X")
                xx = float(tmp_x[1])
            
            elif ("Y" in elm):
                tmp_y = elm.split("Y")
                yy = float(tmp_y[1])
            
            elif ("Z" in elm):
                tmp_z = elm.split("Z")
                zz = float(tmp_z[1])

        ### G28 = Macine Origin
        if xx != None:
            xxx = mo_x - xx
        else:
            xxx = None
        if yy != None:
            yyy = mo_y - yy
        else:
            yyy = None
        
        if zz != None:
            zzz = mo_z - zz
        else:
            zzz = None

        return [xxx, yyy, zzz, None]


    # def get_value_m3(self, str_):


    # def get_value_m4(self, str_):


    def gcode_oprate(self, gcode_line):

        none_list = [None, None, None, None]

        ### Move
        if ("G1" in gcode_line) or ("G01" in gcode_line):
            return self.get_value_g1(gcode_line)

        ### Commment Out
        elif ("(" in gcode_line) or ("%" in gcode_line):
            return none_list

        ### Print Start
        elif ("M3" in gcode_line) or ("M03" in gcode_line):
            # return "m3"
            return none_list

        ### Print Stop
        elif ("M4" in gcode_line) or ("M04" in gcode_line):
            # return "m4"
            return none_list

        ### Move G28
        elif ("G28" in gcode_line):
            # self.get_value_g28(gcode_line
            return none_list

        ### Setting G
        elif ("G4" in gcode_line) or ("G49" in gcode_line) or ("G54" in gcode_line) or ("G80" in gcode_line) or ("G90" in gcode_line) or ("G91" in gcode_line):
            return none_list

        ### Setting M
        elif ("M5" in gcode_line) or ("M7" in gcode_line) or ("M55" in gcode_line):
            return none_list
        
        ### Print S0
        elif ("S0" in gcode_line):
            return none_list

        else:
            return none_list
            # return "BUG"


    def gcode_to_array(self, path):

        ### open gcode
        gcode = self.open_file(path)

        ### Get Vaules from gcode
        values = []
        for i in xrange(len(gcode)):
            gcode_line = gcode[i]
            elements = self.gcode_oprate(gcode_line)

            ### DEBUG
            # if (elements == "BUG"):
            #     print(i, gcode_line)
            ### DEBUG

            values.append(elements)

        ### Padding Previous Value(None)
        values_zip = ut.zip_matrix(values)
        # print(len(values_zip))
        new_values = []
        for j in xrange(len(values_zip)):
            list_ = values_zip[j]
            list_pad = ut.padding_previous_value(list_)
            new_values.append(list_pad)
        gcode_values = ut.zip_matrix(new_values)

        # print(len(values))
        # print(len(gcode_values))

        return gcode_values


    def draw_path(self, values_4):

        ### Remove Same Element as the Previous One
        xyzs = ut.remove_previous_elements(values_4)
        # print(len(values_4), len(xyzs))

        ### Draw All Path
        pts = []
        for i in xrange(len(xyzs)):
            x, y, z, s = xyzs[i]
            pt = [x, y, z]
            pts.append(pt)
        
        return pts

vb = ViewerBig()


###################################


xyzs = vb.gcode_to_array(PATH)

#print(xyzs)
points_ = vb.draw_path(xyzs) 
MOVE = rs.AddPolyline(points_)
# ---------- end python_2 ----------
python_3 = GhPythonScript()  # -> out, a
# ---------- python_3: Python ----------
s = "G1 X0\n"
s_s = s.split("\n")

print(s)
print(s_s)
# ---------- end python_3 ----------
python_4 = GhPythonScript(
    POLYLINES=crv,
    M4_S_VALUE=panel_3,
    M4_STOP_TIME=panel_4,
    F_VALUE=panel_5,
    F_VALUE_1st=panel_6,
    M3_S_VALUE=panel_12,
    M3_S_VALUE_1st=panel_11,
    Z_OFFSET_VALUE=panel_8,
    Z_BUFFER=panel_9,
    EXPORT=button,
    EXPORT_DIR=panel_10)  # -> out, POINTS, DEV; inputs POLYLINES: list
# ---------- python_4: Python ----------
import datetime
import math

import rhinoscriptsyntax as rs
import Rhino.Geometry as rg


class Util():


    def get_current_time(self):
        return str(datetime.datetime.now().strftime("%Y-%m-%d_%H-%M-%S"))


    def remap_number(self, src, old_min, old_max, new_min, new_max):
        return ((src - old_min) / (old_max - old_min) * (new_max - new_min) + new_min)


    def flatten_runtime_list(self, list):
        all = []
        
        for i in xrange(len(list)):
            # print(i)
            sub = list[i]
            for j in xrange(len(sub)):
                # print(j)
                all.append(sub[j])

        return all


    def export_gcode(self, dir_path, txt):

        now = self.get_current_time()
        file_path = dir_path + now + ".gcode"

        ### Export
        with open(file_path, 'w') as f:
            f.write(txt)

        print("Export GCode : {}".format(file_path))


    def zip_matrix(self, mat):
        ### https://note.nkmk.me/python-list-transpose/
        return [list(x) for x in zip(*mat)]


    def padding_previous_value(self, list_):
        
        list_pad = []

        for i in xrange(len(list_)):
            
            item_ = list_[i]

            ### First 
            if i == 0:
                if (item_ == None):
                    list_pad.append(0)
                else:
                    list_pad.append(item_)
            
            ### Not Frist
            else:
                if (item_ == None):
                    tmp = list_pad[i-1]
                    list_pad.append(tmp)
                else:
                    list_pad.append(item_)
        
        return list_pad


    def remove_previous_elements(self, a_list):

        ### Remove Same Element as the Previous One
        new_list = []
        src_length = len(a_list)

        for i in range(src_length):
            tmp = a_list[i]

            ### 
            if i < src_length-1:
                if a_list[i] != a_list[i+1]:
                    new_list.append(tmp)
            ### Last
            else:
                new_list.append(tmp)
                
        return new_list

ut = Util()


class Transform():


    def pt_pt_add(self, pt0, pt1):
        pt = [
            float(pt1[0]) + float(pt0[0]),
            float(pt1[1]) + float(pt0[1]),
            float(pt1[2]) + float(pt0[2])]
        return pt


    def pt_pt_subtract(self, pt0, pt1):
        pt = [
            float(pt0[0]) - float(pt1[0]),
            float(pt0[1]) - float(pt1[1]),
            float(pt0[2]) - float(pt1[2])]
        return pt


    def vector_multiplicate(self, vector, value):
        vec = [
            float(vector[0]) * value,
            float(vector[1]) * value,
            float(vector[2]) * value]
        return vec


    def vector_unitize(self, vector):
        length = math.sqrt(
            math.pow(float(vector[0]), 2) + 
            math.pow(float(vector[1]), 2) + 
            math.pow(float(vector[2]), 2))
        new_vector = self.vector_multiplicate(vector, (1.0 / length))
        return new_vector


    def move_pt_vec(self, pt, vec):
        p = [
            float(pt[0]) + float(vec[0]),
            float(pt[1]) + float(vec[1]),
            float(pt[2]) + float(vec[2])]
        return p

tr = Transform()


class Curve():


    def polyline_to_points(self, polyline):

        points = []

        ### Start Point
        start_pt = rs.CurveStartPoint(polyline)
        points.append(start_pt)

        ### Segment Points
        ### Style : 3 = C2 - Continuous first and second derivative
        segments = rs.CurveDiscontinuity(polyline, 3)
        for j in range(len(segments)):
            points.append(segments[j])

        ### End Point
        end_pt =  rs.CurveEndPoint(polyline)
        points.append(end_pt)
        
        return points


    def polylines_to_points(self, polylines):

        points_array = []

        for i in xrange(len(polylines)):

            points = self.polyline_to_points(polylines[i])
            points_array.append(points)

        return points_array


    def offset_z(self, points, z_offset_value):

        move_vec = [0, 0, z_offset_value]

        points_off = []

        for i in xrange(len(points)):
            sub = []
            tmp = points[i]
            for j in xrange(len(tmp)):
                pt = tmp[j]
                ### offset
                X, Y, Z = tr.move_pt_vec(pt, move_vec)
                pt_off = rg.Point3d(X, Y, Z)
                sub.append(pt_off)
            points_off.append(sub)
        
        return points_off

gc = Curve()


class BigGcode():


    def gcode_start(self):
        return "( == gcode start == )\n%\nG91\nG28 Z0.000\nG28 X0.000 Y0.000\nG49\nG80\nG90\nG54\n( == gcode start == )\n( --- )\n"


    def head_start(self):
        return "( === head1 start ===)\nM55\nM3 S0 P1\nM7\n( === head1 start ===)\n( - )\n"


    def gcode_end(self):
        return "( == gcode end == )\nM3 S0\nM5\nG91\nG28 Z0\nG28 X0 Y0\nM30\n%\n( == gcode end == )\n"


    def define_print_msg(self):
        return "( Polyline to Gcode by Grasshopper )\n( For EB 3D Printer )\n( --- )\n"


    def define_print_parameter(self, f, m3, m4, z_offset, stop_time, z_buffer):
        now = ut.get_current_time()
        return "( Export : {} )\n( F Value : {} )\n( M3 S Value: {} )\n( M4 S Value : {} )\n( M4 Stop Time : {} )\n( Z Offset Value : {} )\n( --- )\n".format(now, f, m3, m4, stop_time, z_offset)


    def define_extrude_filament(self, parge_value):
        return "( ==== Start Printing ==== )\n( == Extrude Filament == )\nM3 S{} P1\n".format(parge_value)


    def define_stop_filament(self, reverse_value, stop_time):
        return "( == Stop Filament == )\nM4 S{} P1\nG4 X{}\nM3 S0\n".format(reverse_value, stop_time)


    def define_travel(self, current_z, z_buffer):
        ### buffer (mm)
        Z_BUFFER = float(z_buffer)
        new_z = str(float(current_z) + Z_BUFFER)
        return ("( == Travel == )\nG1 Z{}\n( - )\n".format(new_z))


    def points_to_gcode(self,points, m3_s, m4_s, f, stop_time, z_buffer):

        txt = []

        ### Printing
        for i in xrange(len(points)):
            _px, _py, _pz = points[i]
            px = str("{:f}".format(_px))
            py = str("{:f}".format(_py))
            pz = str("{:f}".format(_pz))

            txt.append("G1 X{} Y{} Z{} F{}\n".format(px, py, pz, f))

            ### Extrude Filament
            if i == 0:
                ### M3
                txt.append(self.define_extrude_filament(m3_s))

            ### get current z
            if i == (len(points) - 1):
                _cx, _cy, _cz = points[i]
                cz = "{:f}".format(_cz)

        ### Printting Stop
        ### M4
        txt.append(self.define_stop_filament(m4_s, stop_time))

        ### Travel
        txt.append(self.define_travel(cz, z_buffer))

        txt_join = "".join(txt)

        return txt_join


    def points_list_to_gcode(self, points_list, m3_s, m3_s_1st, m4_s, f, f_1st,  z_offset, stop_time, z_buffer):
        
        export = []

        ### print msg, print parameter
        export.append(self.define_print_msg())
        export.append(self.define_print_parameter(f, m3_s, m4_s, z_offset, stop_time, z_buffer))

        ### gcode start
        export.append(self.gcode_start())

        ### head start
        export.append(self.head_start())

        ### gcode
        for i in xrange(len(points_list)):
            
            pts = points_list[i]
            
            ### Fisrt Layer
            if i == 0:
                export.append("( ========= Layer : {} ========= )\n".format(i + 1))
                export.append(self.points_to_gcode(pts, m3_s_1st, m4_s, f_1st, stop_time, z_buffer))
            ### Second - Last Layer
            else:
                export.append("( ========= Layer : {} ========= )\n".format(i + 1))
                export.append(self.points_to_gcode(pts, m3_s, m4_s, f, stop_time, z_buffer))
        
        ### gcode end
        export.append(self.gcode_end())

        export_join = "".join(export)

        return export_join

gg = BigGcode()




##########



### Polylines to Points
pts = gc.polylines_to_points(POLYLINES)
POINTS = ut.flatten_runtime_list(pts)


### Z OFFSET
pts_off = gc.offset_z(pts, Z_OFFSET_VALUE)
DEV = ut.flatten_runtime_list(pts_off)


### Points to Gcode
gcode = gg.points_list_to_gcode(pts_off, M3_S_VALUE, M3_S_VALUE_1st, M4_S_VALUE, F_VALUE, F_VALUE_1st, Z_OFFSET_VALUE, M4_STOP_TIME, Z_BUFFER)



if EXPORT == True:
    ut.export_gcode(EXPORT_DIR, gcode)
# ---------- end python_4 ----------
pline = PolyLine(Vertices=python_4.DEV, Closed=False)  # disabled
panel_13 = Panel(python_4.out)
pt = Point(python_4.POINTS)
panel_14 = Panel("C:\Users\yoshioca\Documents\GH_Gcode\_data_\data_out\")

# ---- group: Draw Sequence
divide = DivideCurve(Curve=python_2.MOVE, Count=1000, Kinks=False)  # -> Points, Tangents, Parameters
item = ListItem(List=divide.Points, Index=Slider(470, range=0..1000), Wrap=True)
sph = Sphere(Base=item, Radius=5)

# ---- group: Build Plate
swatch = ColourSwatch(SwatchColor=RGB(187, 255, 255))  # disabled
python_5 = GhPythonScript()  # -> out, AREA; disabled
# ---------- python_5: Python ----------
import rhinoscriptsyntax as rs

AREA = rs.AddRectangle(rs.WorldXYPlane(), 1700, 1300)
# ---------- end python_5 ----------
preview_2 = CustomPreview(Geometry=python_5.AREA, Material=swatch)  # disabled
