# Grasshopper definition big_200912.ghx (Grasshopper 1.0.7)

crv = Curve(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)
simplify = SimplifyCurve(Curve=crv)  # -> Curve, Simplified
divlength = DivideLength(Curve=simplify.Curve, Length=Slider(2, range=0..10))  # -> Points, Tangents, Parameters
number_slider = Slider(100, range=0..100)
pline = PolyLine(Vertices=divlength.Points, Closed=False)
simplify_2 = SimplifyCurve(Curve=pline, Tolerance=Slider(1000, range=0..1000))  # -> Curve, Simplified
series = Series(Start=0, Step=Slider(3, range=0..10), Count=number_slider)
Z = UnitZ(Factor=series)
move = Move(Geometry=simplify_2.Curve, Motion=Z)  # -> Geometry, Transform
bbox = BoundingBox(Content=move.Geometry, Plane=PlaneXY(0, 0, 0))  # -> Box, Box_2
series_2 = Series(Start=0, Step=Slider(0.003, range=0..0.1), Count=number_slider)
area = Area(Geometry=bbox.Box)  # -> Area, Centroid
subtraction = Subtraction(A=1, B=series_2)
scale = Scale(Geometry=move.Geometry, Center=area.Centroid, Factor=subtraction)  # -> Geometry, Transform
panel = Panel(scale.Geometry)

# ---- group: TEST
crv_2 = Curve([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])

# ---- group: Face Sheild
crv_3 = Curve([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])

# ---- group: Input Polyline
# Release : 200912
# - Polyline to GCode -
crv_4 = Curve(crv_2)

# ---- group: Desktop
# - Viewer -
panel_2 = Panel("C:\Users\ysoky\Documents\Digital_Artisan\GH_Gcode\_data_\data_out\2020-05-14_11-51-40.gcode")
panel_3 = Panel("C:\Users\ysoky\Documents\Digital_Artisan\GH_Gcode\_data_\EB_Daihatsu_seal_ysok_fanuc.gcode")

# ---- group: Laptop
panel_4 = Panel("C:\Users\yoshioca\Documents\GH_Gcode\_data_\data_out\2020-05-02_01-18-43.gcode")
panel_5 = Panel("C:\Users\yoshioca\Documents\GH_Gcode\_data_\EB_Daihatsu_seal_ysok_fanuc.gcode")

# ----
panel_6 = Panel("C:\Users\yoshioca\Documents\GH_Gcode\_data_\data_marlin\S_Bunny_275_short.gcode")
# - Viewer (Marlin) -
panel_7 = Panel("C:\Users\ysoky\Documents\Digital_Artisan\GH_Gcode\_data_\bunny.gcode")
panel_8 = Panel("C:\Users\ysoky\Documents\Digital_Artisan\GH_Gcode\_data_\data_marlin\S_Bunny_275.gcode")
panel_9 = Panel("C:\Users\yoshioca\Documents\GH_Gcode\_data_\data_marlin\S_Bunny_275.gcode")
panel_10 = Panel("C:\Users\ysoky\Documents\Digital_Artisan\GH_Gcode\_data_\data_out\new_2020-09-13_02-33-41.gcode")

# ---- group: Export
button = Button()

# ---- group: Export Path
panel_11 = Panel("C:\Users\yoshioca\Documents\GH_Gcode\_data_\data_out\")
panel_12 = Panel("C:\Users\ysoky\Documents\Digital_Artisan\GH_Gcode\_data_\data_out\new_")

# ---- group: Z_OFFSET
panel_13 = Panel("5")

# ----
list = ValueList({"M7_ON": 0, "M7_OFF": 1}, selected="M7_OFF")

# ---- group: Z_Buffer (Travel)
panel_14 = Panel("5")

# ---- group: F
panel_15 = Panel("1800")

# ---- group: F (1st Layer)
panel_16 = Panel("1000")

# ---- group: FS (M3 S = 0.04 * F)
panel_17 = Panel("0.04")

# ----
python = GhPythonScript(F=panel_15, F_1st=panel_16, AMP=panel_17)  # -> M3, M3_1st
# ---------- python: Python ----------
ghenv.Component.Message = 'F to S / 200625'

M3 = int(float(F) * float(AMP))
M3_1st = int(float(F_1st) * float(AMP))
# ---------- end python ----------
polyline_to_points = GhPythonScript(POLYLINES=crv_4, Z_OFFSET_VALUE=panel_13, PRINT_PREVIEW=Toggle(False))  # -> MACHINE, MESSAGE, PRINT_CURVES, PRINT_BBOX, PRINT_LENGTH, POINTS, INFO; inputs POLYLINES: list
# ---------- polyline_to_points: Python ----------
import datetime
import math

import rhinoscriptsyntax as rs
import Rhino.Geometry as rg


class Util():


    def get_current_time(self):
        return str(datetime.datetime.now().strftime("%Y-%m-%d_%H-%M-%S"))


    def remap_number(self, src, old_min, old_max, new_min, new_max):
        return ((src - old_min) / (old_max - old_min) * (new_max - new_min) + new_min)


    def flatten_runtime_list(self, list):
        all = []
        
        for i in xrange(len(list)):
            # print(i)
            sub = list[i]
            for j in xrange(len(sub)):
                # print(j)
                all.append(sub[j])

        return all


    def export_gcode(self, dir_path, txt):

        now = self.get_current_time()
        file_path = dir_path + now + ".gcode"

        ### Export
        with open(file_path, 'w') as f:
            f.write(txt)

        print("Export GCode : {}".format(file_path))


    def zip_matrix(self, mat):
        ### https://note.nkmk.me/python-list-transpose/
        return [list(x) for x in zip(*mat)]


    def padding_previous_value(self, list_):
        
        list_pad = []

        for i in xrange(len(list_)):
            
            item_ = list_[i]

            ### First 
            if i == 0:
                if (item_ == None):
                    list_pad.append(0)
                else:
                    list_pad.append(item_)
            
            ### Not Frist
            else:
                if (item_ == None):
                    tmp = list_pad[i-1]
                    list_pad.append(tmp)
                else:
                    list_pad.append(item_)
        
        return list_pad


    def remove_previous_elements(self, a_list):

        ### Remove Same Element as the Previous One
        new_list = []
        src_length = len(a_list)

        for i in range(src_length):
            tmp = a_list[i]

            ### 
            if i < src_length-1:
                if a_list[i] != a_list[i+1]:
                    new_list.append(tmp)
            ### Last
            else:
                new_list.append(tmp)
                
        return new_list


### Utilities fo EB
class Util_EB(Util):


    def calc_print_area(self, points_array):

        pts = self.flatten_runtime_list(points_array)
        bbox = rg.BoundingBox(pts)
        
        return bbox.Min, bbox.Max


    def check_print_area(self, points_array):

        machine_min = [0, 0, 0]
        machine_max = [1700, 1300, 1020]
        
        print_min, print_max = self.calc_print_area(points_array)

        bbox = None
        msg = []

        ### Draw Bouinding Box
        bbox = rg.BoundingBox(print_min, print_max)

        ### Check Print Area
        ### Left
        if machine_min[0] > print_min[0]:
            msg.append("Over X_Mini!!\n")

        ### Right
        if machine_max[0] < print_max[0]:
            msg.append("Over X_Max!!\n")

        ### Front
        if machine_min[1] > print_min[1]:
            msg.append("Over Y_Mini!!\n")

        ### Back
        if machine_max[1] < print_max[1]:
            msg.append("Over Y_Max!!\n")
        
        ### Bottom
        if machine_min[2] > print_min[2]:
            msg.append("Over Z_Mini!!\n")

        if msg == []:
            msg.append("OK!!")

        return msg, bbox


    def draw_machine(self):

        rects = []

        machine_origin = [-69, -100]
        machine_max = [1700, 1300]

        ### Panel
        panel_size = 500
        panel_count = 12
        vv = 3

        for i in xrange(panel_count):

            u, v = divmod(i, vv)
            tmp_origin = (machine_origin[0] + (500 * u) , machine_origin[1] + (500 *v), 0)
            pl = rs.MovePlane(rs.WorldXYPlane(), tmp_origin)
            rc = rs.AddRectangle(pl, panel_size, panel_size)
            rects.append(rc)

        ### Print Area
        print_origin = (0, 0, 0)
        pl = rs.MovePlane(rs.WorldXYPlane(), print_origin)
        rc = rs.AddRectangle(pl, machine_max[0], machine_max[1])
        rects.append(rc)

        return rects


    def print_preview(self, points_array):

        pls = []
        lens_ = 0.0

        for i in xrange(len(points_array)):
            pl = rg.Polyline(points_array[i])
            pls.append(pl)
            
            len_ = pl.Length
            lens_ += float(len_)
        
        lens_int = int(lens_)

        return pls, lens_int

ut = Util_EB()


class Transform():


    def pt_pt_add(self, pt0, pt1):
        pt = [
            float(pt1[0]) + float(pt0[0]),
            float(pt1[1]) + float(pt0[1]),
            float(pt1[2]) + float(pt0[2])]
        return pt


    def pt_pt_subtract(self, pt0, pt1):
        pt = [
            float(pt0[0]) - float(pt1[0]),
            float(pt0[1]) - float(pt1[1]),
            float(pt0[2]) - float(pt1[2])]
        return pt


    def vector_multiplicate(self, vector, value):
        vec = [
            float(vector[0]) * value,
            float(vector[1]) * value,
            float(vector[2]) * value]
        return vec


    def vector_unitize(self, vector):
        length = math.sqrt(
            math.pow(float(vector[0]), 2) + 
            math.pow(float(vector[1]), 2) + 
            math.pow(float(vector[2]), 2))
        new_vector = self.vector_multiplicate(vector, (1.0 / length))
        return new_vector


    def move_pt_vec(self, pt, vec):
        p = [
            float(pt[0]) + float(vec[0]),
            float(pt[1]) + float(vec[1]),
            float(pt[2]) + float(vec[2])]
        return p

tr = Transform()


class Curve():


    def polyline_to_points(self, polyline):

        ########## NEW CODE ##########

        ### Polyline to Points by RhinoCommon
        pl = rs.coercegeometry(polyline)
        new_pl = rg.PolylineCurve.ToPolyline(pl)
        points = new_pl.ToArray()

        ########## NEW CODE ##########


        """
        ########## OLD CODE 1 ##########

        points = []

        ### Start Point
        start_pt = rs.CurveStartPoint(polyline)
        points.append(start_pt)

        ### Segment Points
        ### Style : 3 = C2 - Continuous first and second derivative
        segments = rs.CurveDiscontinuity(polyline, 3)
        for j in range(len(segments)):
            points.append(segments[j])

        ### End Point
        end_pt =  rs.CurveEndPoint(polyline)
        points.append(end_pt)

        ########## OLD CODE 1 ##########

        ########## OLD CODE 2 ##########
        
        ### Polyline to Points by rhinoscriptsuntax
        ### https://developer.rhino3d.com/api/RhinoScriptSyntax/#collapse-PolylineVertices
        
        points = rs.PolylineVertices(polyline)
        
        ########## OLD CODE 2 ##########
        """
        
        return points


    def polylines_to_points(self, polylines):

        points_array = []

        for i in xrange(len(polylines)):

            points = self.polyline_to_points(polylines[i])
            points_array.append(points)

        return points_array


    def offset_z_points(self, points, z_offset_value):

        move_vec = [0, 0, z_offset_value]

        points_off = []

        for i in xrange(len(points)):
            sub = []
            tmp = points[i]
            for j in xrange(len(tmp)):
                pt = tmp[j]
                ### offset
                X, Y, Z = tr.move_pt_vec(pt, move_vec)
                pt_off = rg.Point3d(X, Y, Z)
                sub.append(pt_off)
            points_off.append(sub)
        
        return points_off


    def offset_z_curves(self, curves, z_offset_value):

        move_vec = rs.CreateVector(0, 0, z_offset_value)
        geos_off = rs.MoveObjects(curves, move_vec)
        
        return geos_off

op_c = Curve()



##########

##########


ghenv.Component.Message = '(1) Polylines to Points / 200912'


### Z OFFSET
offset_curves = op_c.offset_z_curves(POLYLINES, Z_OFFSET_VALUE)
#DEV = offset_curves
INFO = Z_OFFSET_VALUE


### Polylines to Points
pts = op_c.polylines_to_points(offset_curves)
POINTS = pts


### Machine Info
mach = ut.draw_machine()
MACHINE = mach

### Print Area Check
msg, bbox = ut.check_print_area(pts)
MESSAGE = msg

### Print Preview
if __PRINT_PREVIEW == True:
    print_crvs, print_len = ut.print_preview(pts)
    __PRINT_BBOX = bbox
    __PRINT_CURVES = print_crvs
    __PRINT_LENGTH = print_len
# ---------- end polyline_to_points ----------
panel_18 = Panel(python.M3)
panel_19 = Panel(python.M3_1st)
python_2 = GhPythonScript(PATH=panel_8)  # -> out, MOVE, a; disabled
# ---------- python_2: Python ----------
import rhinoscriptsyntax as rs
import Rhino.Geometry as rg

import datetime
import math
import time


class Util():


    def get_current_time(self):
        return str(datetime.datetime.now().strftime("%Y-%m-%d_%H-%M-%S"))


    def remap_number(self, src, old_min, old_max, new_min, new_max):
        return ((src - old_min) / (old_max - old_min) * (new_max - new_min) + new_min)


    def flatten_runtime_list(self, list):
        all = []
        
        for i in xrange(len(list)):
            # print(i)
            sub = list[i]
            for j in xrange(len(sub)):
                # print(j)
                all.append(sub[j])

        return all


    def export_gcode(self, dir_path, txt):

        now = self.get_current_time()
        file_path = dir_path + now + ".gcode"

        ### Export
        with open(file_path, 'w') as f:
            f.write(txt)

        print("Export GCode : {}".format(file_path))


    def zip_matrix(self, mat):
        ### https://note.nkmk.me/python-list-transpose/
        return [list(x) for x in zip(*mat)]


    def padding_previous_value(self, list_):
        
        list_pad = []

        for i in xrange(len(list_)):
            
            item_ = list_[i]

            ### First 
            if i == 0:
                if (item_ == None):
                    list_pad.append(0)
                else:
                    list_pad.append(item_)
            
            ### Not Frist
            else:
                if (item_ == None):
                    tmp = list_pad[i-1]
                    list_pad.append(tmp)
                else:
                    list_pad.append(item_)
        
        return list_pad


    def remove_previous_elements(self, a_list):

        ### Remove Same Element as the Previous One
        new_list = []
        src_length = len(a_list)

        for i in range(src_length):
            tmp = a_list[i]

            ### 
            if i < src_length-1:
                if a_list[i] != a_list[i+1]:
                    new_list.append(tmp)
            ### Last
            else:
                new_list.append(tmp)
                
        return new_list

ut = Util()


class ViewerMarlin():
    
    
    def open_file(self, path):
        with open(path) as f:
            l = f.readlines()
        # print(type(l))
        # print(len(l))
        # print(l)
        return l


    def get_value_move(self, str_):
        
        ### Split Elements
        ### Remove n
        str_.replace("\n", "")
        
        ### Remove Comments
        if ";" in str_:
            str_rm_comment = str_.split(";")
            new_str = str_rm_comment[0]
        else:
            new_str = str_

        ### Gcode (per Line)
        # print(new_str)

        ### Sprit Space
        elements = new_str.split()

        ### init
        xx = None
        yy = None
        zz = None
        ee = None
        
        for i in xrange(len(elements)):
            elm = elements[i]

            ### Get Value
            if ("X" in elm):
                tmp_x = elm.split("X")
                xx = float(tmp_x[1])
            
            elif ("Y" in elm):
                tmp_y = elm.split("Y")
                yy = float(tmp_y[1])
            
            elif ("Z" in elm):
                tmp_z = elm.split("Z")
                zz = float(tmp_z[1])

            elif ("E" in elm):
                tmp_e = elm.split("E")
                ee = float(tmp_e[1])

        return [xx, yy, zz, ee]


    def gcode_operate_move(self, gcode_line):

        none_list = [None, None, None, None]

        ### Move
        if ("G0" in gcode_line) or \
            ("G1" in gcode_line) or \
            ("G00" in gcode_line) or \
            ("G01" in gcode_line) or \
            ("G92 E0" in gcode_line):
            ### get position
            return self.get_value_move(gcode_line)

        ### Commment Out
        elif (";" in gcode_line[0]) or (gcode_line == "\n"):
            return none_list

        ### Setting G
        elif ("G4" in gcode_line) or \
            ("G04" in gcode_line) or \
            ("G21" in gcode_line) or \
            ("G28" in gcode_line) or \
            ("G90" in gcode_line) or \
            ("G91" in gcode_line) or \
            ("G92" in gcode_line):
            
            return none_list

        ### Setting M
        elif ("M82" in gcode_line) or \
            ("M84" in gcode_line) or \
            ("M104" in gcode_line) or \
            ("M106" in gcode_line) or \
            ("M107" in gcode_line) or \
            ("M109" in gcode_line) or \
            ("M140" in gcode_line) or \
            ("M190" in gcode_line) or \
            ("M204" in gcode_line) or \
            ("M205" in gcode_line):

            return none_list
        
        ### Setting T
        elif ("T0" in gcode_line) or \
            ("T1" in gcode_line):
            return none_list

        else:
            # return none_list
            return "bug!"


    def gcode_to_array(self, path):

        ### open gcode
        gcode = self.open_file(path)

        ### Get Vaules from gcode
        values = []
        for i in xrange(len(gcode)):
            gcode_line = gcode[i]

            ### XYZE
            elements = self.gcode_operate_move(gcode_line)

            ## DEBUG ALL
            # print(i, gcode_line)
            ### DEBUG bug
            if (elements == "bug!"):
                print(i, gcode_line)
            ## DEBUG

            values.append(elements)

        ### Padding Previous Value(None)
        values_zip = ut.zip_matrix(values)
        # print(len(values_zip))
        new_values = []
        for j in xrange(len(values_zip)):
            list_ = values_zip[j]
            list_pad = ut.padding_previous_value(list_)
            new_values.append(list_pad)
        gcode_values = ut.zip_matrix(new_values)

        # print(len(values))
        # print(len(gcode_values), len(gcode_values[0]))

        return gcode_values


    def draw_path(self, values_4):

        ### Remove Same Element as the Previous One
        xyze = ut.remove_previous_elements(values_4)
        ### print(len(values_4), len(xyze))

        ###
        ### Segment Print / Travel
        ###

        ### Draw All Path
        pts = []
        for i in xrange(len(xyze)):
            x, y, z, e = values_4[i]
            pt = [x, y, z]
            pts.append(pt)
        
        return pts

vm = ViewerMarlin()


###################################

###################################


ghenv.Component.Message = 'Viewer_Marlin / 200821'



time_0 = time.time()


### gcode-file to Memory
xyze = vm.gcode_to_array(PATH)


time_1 = time.time()


### Pick Values
xyz = vm.draw_path(xyze)



time_2 = time.time()


### Draw Printing
MOVE = rs.AddPolyline(xyz)


time_3 = time.time()




#time_01 = time_1 - time_0
#time_12 = time_2 - time_1
#time_23 = time_3 - time_2
#
#print ("Time 01 : {0}".format(time_01) + "[sec]")
#print ("Time 12 : {0}".format(time_12) + "[sec]")
#print ("Time 23 : {0}".format(time_23) + "[sec]")
# ---------- end python_2 ----------
python_3 = GhPythonScript(PATH=panel_10)  # -> out, MOVE
# ---------- python_3: Python ----------
import rhinoscriptsyntax as rs
import Rhino.Geometry as rg

import datetime
import math
import time


class Util():


    def get_current_time(self):
        return str(datetime.datetime.now().strftime("%Y-%m-%d_%H-%M-%S"))


    def remap_number(self, src, old_min, old_max, new_min, new_max):
        return ((src - old_min) / (old_max - old_min) * (new_max - new_min) + new_min)


    def flatten_runtime_list(self, list):
        all = []
        
        for i in xrange(len(list)):
            # print(i)
            sub = list[i]
            for j in xrange(len(sub)):
                # print(j)
                all.append(sub[j])

        return all


    def export_gcode(self, dir_path, txt):

        now = self.get_current_time()
        file_path = dir_path + now + ".gcode"

        ### Export
        with open(file_path, 'w') as f:
            f.write(txt)

        print("Export GCode : {}".format(file_path))


    def zip_matrix(self, mat):
        ### https://note.nkmk.me/python-list-transpose/
        return [list(x) for x in zip(*mat)]


    def padding_previous_value(self, list_):
        
        list_pad = []

        for i in xrange(len(list_)):
            
            item_ = list_[i]

            ### First 
            if i == 0:
                if (item_ == None):
                    list_pad.append(0)
                else:
                    list_pad.append(item_)
            
            ### Not Frist
            else:
                if (item_ == None):
                    tmp = list_pad[i-1]
                    list_pad.append(tmp)
                else:
                    list_pad.append(item_)
        
        return list_pad


    def remove_previous_elements(self, a_list):

        ### Remove Same Element as the Previous One
        new_list = []
        src_length = len(a_list)

        for i in range(src_length):
            tmp = a_list[i]

            ### 
            if i < src_length-1:
                if a_list[i] != a_list[i+1]:
                    new_list.append(tmp)
            ### Last
            else:
                new_list.append(tmp)
                
        return new_list

ut = Util()


class ViewerBig():
    
    
    def open_file(self, path):
        with open(path) as f:
            l = f.readlines()
        # print(type(l))
        # print(len(l))
        # print(l)
        return l


    def get_value_g1(self, str_):
        
        ### Split Elements
        elements = str_.split()

        ### init
        xx = None
        yy = None
        zz = None
        
        for i in xrange(len(elements)):
            elm = elements[i]

            ### Get Value
            if ("X" in elm):
                tmp_x = elm.split("X")
                xx = float(tmp_x[1])
            
            elif ("Y" in elm):
                tmp_y = elm.split("Y")
                yy = float(tmp_y[1])
            
            elif ("Z" in elm):
                tmp_z = elm.split("Z")
                zz = float(tmp_z[1])

        return [xx, yy, zz, None]


    def get_value_g28(self, str_):
        
        ### G28 = Machine Origin
        mo_x, mo_y, mo_z = [0, 0, 1300]

        ### Split Elements
        elements = str_.split()

        ### init
        xx = None
        yy = None
        zz = None

        for i in xrange(len(elements)):
            elm = elements[i]

            ### Get Value
            if ("X" in elm):
                tmp_x = elm.split("X")
                xx = float(tmp_x[1])
            
            elif ("Y" in elm):
                tmp_y = elm.split("Y")
                yy = float(tmp_y[1])
            
            elif ("Z" in elm):
                tmp_z = elm.split("Z")
                zz = float(tmp_z[1])

        ### G28 = Macine Origin
        if xx != None:
            xxx = mo_x - xx
        else:
            xxx = None
        if yy != None:
            yyy = mo_y - yy
        else:
            yyy = None
        
        if zz != None:
            zzz = mo_z - zz
        else:
            zzz = None

        return [xxx, yyy, zzz, None]


    # def get_value_m3(self, str_):


    # def get_value_m4(self, str_):


    def gcode_oprate(self, gcode_line):

        none_list = [None, None, None, None]

        ### Move
        if ("G1" in gcode_line) or ("G01" in gcode_line):
            return self.get_value_g1(gcode_line)

        ### Commment Out
        elif ("(" in gcode_line) or ("%" in gcode_line):
            return none_list

        ### Print Start
        elif ("M3" in gcode_line) or ("M03" in gcode_line):
            # return "m3"
            return none_list

        ### Print Stop
        elif ("M4" in gcode_line) or ("M04" in gcode_line):
            # return "m4"
            return none_list

        ### Move G28
        elif ("G28" in gcode_line):
            # self.get_value_g28(gcode_line
            return none_list

        ### Setting G
        elif ("G4" in gcode_line) or ("G49" in gcode_line) or ("G54" in gcode_line) or ("G80" in gcode_line) or ("G90" in gcode_line) or ("G91" in gcode_line):
            return none_list

        ### Setting M
        elif ("M5" in gcode_line) or ("M7" in gcode_line) or ("M55" in gcode_line):
            return none_list
        
        ### Print S0
        elif ("S0" in gcode_line):
            return none_list

        else:
            return none_list
            # return "BUG"


    def gcode_to_array(self, path):

        ### open gcode
        gcode = self.open_file(path)

        ### Get Vaules from gcode
        values = []
        for i in xrange(len(gcode)):
            gcode_line = gcode[i]
            elements = self.gcode_oprate(gcode_line)

            ### DEBUG
            # if (elements == "BUG"):
            #     print(i, gcode_line)
            ### DEBUG

            values.append(elements)

        ### Padding Previous Value(None)
        values_zip = ut.zip_matrix(values)
        # print(len(values_zip))
        new_values = []
        for j in xrange(len(values_zip)):
            list_ = values_zip[j]
            list_pad = ut.padding_previous_value(list_)
            new_values.append(list_pad)
        gcode_values = ut.zip_matrix(new_values)

        # print(len(values))
        # print(len(gcode_values))

        return gcode_values


    def draw_path(self, values_4):

        ### Remove Same Element as the Previous One
        xyzs = ut.remove_previous_elements(values_4)
        # print(len(values_4), len(xyzs))

        ### Draw All Path
        pts = []
        for i in xrange(len(xyzs)):
            x, y, z, s = xyzs[i]
            pt = [x, y, z]
            pts.append(pt)
        
        return pts

vb = ViewerBig()


###################################

###################################


ghenv.Component.Message = 'Viewer / 200821'


time_0 = time.time()


### gcode-file to Memory
xyzs = vb.gcode_to_array(PATH)


time_1 = time.time()


### Pick Values
points_ = vb.draw_path(xyzs)


time_2 = time.time()


### Draw Printing
MOVE = rs.AddPolyline(points_)


time_3 = time.time()




#time_01 = time_1 - time_0
#time_12 = time_2 - time_1
#time_23 = time_3 - time_2
#
#print ("Time 01 : {0}".format(time_01) + "[sec]")
#print ("Time 12 : {0}".format(time_12) + "[sec]")
#print ("Time 23 : {0}".format(time_23) + "[sec]")
# ---------- end python_3 ----------
panel_20 = Panel(polyline_to_points.MESSAGE)
panel_21 = Panel(polyline_to_points.PRINT_LENGTH)
python_4 = GhPythonScript(
    POINTS=polyline_to_points.POINTS,
    INFO=polyline_to_points.INFO,
    M7_ON=list,
    F_VALUE=panel_15,
    F_VALUE_1st=panel_16,
    M3_S_VALUE=panel_18,
    M3_S_VALUE_1st=panel_19,
    Z_BUFFER=panel_14,
    EXPORT_DIR=panel_12,
    RUN_AND_EXPORT=button)  # -> out, DEV; inputs POINTS: list
# ---------- python_4: Python ----------
import datetime
import math

import rhinoscriptsyntax as rs
import Rhino.Geometry as rg


class Util():


    def get_current_time(self):
        return str(datetime.datetime.now().strftime("%Y-%m-%d_%H-%M-%S"))


    def remap_number(self, src, old_min, old_max, new_min, new_max):
        return ((src - old_min) / (old_max - old_min) * (new_max - new_min) + new_min)


    def flatten_runtime_list(self, list):
        all = []
        
        for i in xrange(len(list)):
            # print(i)
            sub = list[i]
            for j in xrange(len(sub)):
                # print(j)
                all.append(sub[j])

        return all


    def export_gcode(self, dir_path, txt):

        now = self.get_current_time()
        file_path = dir_path + now + ".gcode"

        ### Export
        with open(file_path, 'w') as f:
            f.write(txt)

        print("Export GCode : {}".format(file_path))


    def zip_matrix(self, mat):
        ### https://note.nkmk.me/python-list-transpose/
        return [list(x) for x in zip(*mat)]


    def padding_previous_value(self, list_):
        
        list_pad = []

        for i in xrange(len(list_)):
            
            item_ = list_[i]

            ### First 
            if i == 0:
                if (item_ == None):
                    list_pad.append(0)
                else:
                    list_pad.append(item_)
            
            ### Not Frist
            else:
                if (item_ == None):
                    tmp = list_pad[i-1]
                    list_pad.append(tmp)
                else:
                    list_pad.append(item_)
        
        return list_pad


    def remove_previous_elements(self, a_list):

        ### Remove Same Element as the Previous One
        new_list = []
        src_length = len(a_list)

        for i in range(src_length):
            tmp = a_list[i]

            ### 
            if i < src_length-1:
                if a_list[i] != a_list[i+1]:
                    new_list.append(tmp)
            ### Last
            else:
                new_list.append(tmp)
                
        return new_list


### Utilities fo EB
class Util_EB(Util):


    def calc_print_area(self, points_array):

        pts = self.flatten_runtime_list(points_array)
        bbox = rg.BoundingBox(pts)
        
        return bbox.Min, bbox.Max


    def check_print_area(self, points_array):

        machine_min = [0, 0, 0]
        machine_max = [1700, 1300, 1020]
        
        print_min, print_max = self.calc_print_area(points_array)

        bbox = None
        msg = []

        ### Draw Bouinding Box
        bbox = rg.BoundingBox(print_min, print_max)

        ### Check Print Area
        ### Left
        if machine_min[0] > print_min[0]:
            msg.append("Over X_Mini!!\n")

        ### Right
        if machine_max[0] < print_max[0]:
            msg.append("Over X_Max!!\n")

        ### Front
        if machine_min[1] > print_min[1]:
            msg.append("Over Y_Mini!!\n")

        ### Back
        if machine_max[1] < print_max[1]:
            msg.append("Over Y_Max!!\n")
        
        ### Bottom
        if machine_min[2] > print_min[2]:
            msg.append("Over Z_Mini!!\n")

        if msg == []:
            msg.append("OK!!")

        return msg, bbox


    def draw_machine(self):

        rects = []

        machine_origin = [-69, -100]
        machine_max = [1700, 1300]

        ### Panel
        panel_size = 500
        panel_count = 12
        vv = 3

        for i in xrange(panel_count):

            u, v = divmod(i, vv)
            tmp_origin = (machine_origin[0] + (500 * u) , machine_origin[1] + (500 *v), 0)
            pl = rs.MovePlane(rs.WorldXYPlane(), tmp_origin)
            rc = rs.AddRectangle(pl, panel_size, panel_size)
            rects.append(rc)

        ### Print Area
        print_origin = (0, 0, 0)
        pl = rs.MovePlane(rs.WorldXYPlane(), print_origin)
        rc = rs.AddRectangle(pl, machine_max[0], machine_max[1])
        rects.append(rc)

        return rects


    def print_preview(self, points_array):

        pls = []
        lens_ = 0.0

        for i in xrange(len(points_array)):
            pl = rg.Polyline(points_array[i])
            pls.append(pl)
            
            len_ = pl.Length
            lens_ += float(len_)
        
        lens_int = int(lens_)

        return pls, lens_int

ut = Util_EB()


class Transform():


    def pt_pt_add(self, pt0, pt1):
        pt = [
            float(pt1[0]) + float(pt0[0]),
            float(pt1[1]) + float(pt0[1]),
            float(pt1[2]) + float(pt0[2])]
        return pt


    def pt_pt_subtract(self, pt0, pt1):
        pt = [
            float(pt0[0]) - float(pt1[0]),
            float(pt0[1]) - float(pt1[1]),
            float(pt0[2]) - float(pt1[2])]
        return pt


    def vector_multiplicate(self, vector, value):
        vec = [
            float(vector[0]) * value,
            float(vector[1]) * value,
            float(vector[2]) * value]
        return vec


    def vector_unitize(self, vector):
        length = math.sqrt(
            math.pow(float(vector[0]), 2) + 
            math.pow(float(vector[1]), 2) + 
            math.pow(float(vector[2]), 2))
        new_vector = self.vector_multiplicate(vector, (1.0 / length))
        return new_vector


    def move_pt_vec(self, pt, vec):
        p = [
            float(pt[0]) + float(vec[0]),
            float(pt[1]) + float(vec[1]),
            float(pt[2]) + float(vec[2])]
        return p

tr = Transform()


class BigGcode():


    def gcode_start(self):
        ### Original
        ### Go Through Machine Origin, Gcode Start
        return "%\nG91 ( == gcode start == )\nG28 Z0.000\nG28 X0.000 Y0.000\nG49\nG80\nG90\nG54\n"


    def gcode_start_no_origin(self):
        ### Not Go Through Machine Origin, Gcode Start
        return "%\nG91 ( == gcode start == )\nG49\nG80\nG90\nG54\n"


    def head1_start(self, m7_tf):
        ### Select M7 (Nozzle Fan) ON-OFF
        if str(m7_tf) == "0":
            return "M55 ( === head1 start ===)\nM3 S0 P1\nM7\n"
        else:
            return "M55 ( === head1 start ===)\nM3 S0 P1\n"


    def head2_start(self):
        return "( === head2 start ===)\nM57\nM13 S0 P2\nM7\n( === head2 start ===)\n( - )\n"


    def gcode_end(self):
        ### Original
        ### Go Through Machine Origin, Gcode End
        return "\nM3 S0 ( == gcode end == )\nM5\nG91\nG28 Z0\nG28 X0 Y0\nM30\n%\n( == gcode end == )\n"


    def gcode_end_no_origin(self):
        ### Not Go Through Machine Origin, Gcode End
        return "M3 S0 ( == gcode end == )\nM5\nG91\nG28 Z0\nM30\n%\n"


    def define_print_msg(self):
        return "( Polyline to Gcode by Grasshopper )\n( For EB 3D Printer )\n( --- )\n"


    def define_print_parameter(self, component, f, m3, m4, z_offset, stop_time, z_buffer):

        now = ut.get_current_time()
        time = "( Export : {} )\n".format(now)
        comp_info = "( Component Info : {} )\n".format(component)
        ### M4
        # values = "( F Value : {} )\n( M3 S Value: {} )\n( M4 S Value : {} )\n( M4 Stop Time : {} )\n( Z Offset Value : {} )\n".format(f, m3, m4, stop_time, z_offset)
        ### M4 Removed
        values = "( F Value : {} )\n( M3 S Value: {} )\n( Z Offset Value : {} )\n".format(f, m3, z_offset)
        line = "( --- )\n"

        return time + comp_info + values + line


    def define_extrude_filament(self, parge_value):
        return "M3 S{} P1 ( == Extrude Filament == )\n".format(parge_value)


    def define_stop_filament(self, reverse_value, stop_time):
        ### M4 (Reversed)
        # return "( == Stop Filament == )\nM4 S{} P1\nG4 X{}\nM3 S0\n".format(reverse_value, stop_time)
        ### M3
        return "M3 S0 ( == Stop Filament == )\n"


    def define_travel(self, current_z, z_buffer):
        ### buffer (mm)
        Z_BUFFER = float(z_buffer)
        new_z = str(float(current_z) + Z_BUFFER)
        return ("G1 Z{} ( == Travel == )\n".format(new_z))


    def points_to_gcode(self, layer_info, points, m3_s, m4_s, f, stop_time, z_buffer):

        txt = []

        ### Printing
        for i in xrange(len(points)):
            _px, _py, _pz = points[i]
            px = str("{:f}".format(_px))
            py = str("{:f}".format(_py))
            pz = str("{:f}".format(_pz))

            ### Add Layer Info on First Layer
            if i == 0:
                txt.append("G1 X{} Y{} Z{} F{} {}\n".format(px, py, pz, f, layer_info))
            else:
                txt.append("G1 X{} Y{} Z{} F{}\n".format(px, py, pz, f))

            ### Extrude Filament
            if i == 0:
                ### M3
                txt.append(self.define_extrude_filament(m3_s))

            ### get current z
            if i == (len(points) - 1):
                _cx, _cy, _cz = points[i]
                cz = "{:f}".format(_cz)

        ### Printting Stop
        ### M4
        txt.append(self.define_stop_filament(m4_s, stop_time))

        ### Travel
        txt.append(self.define_travel(cz, z_buffer))

        txt_join = "".join(txt)

        return txt_join


    # def points_list_to_gcode(self, points_list, comp_info, m3_s, m3_s_1st, m4_s, f, f_1st,  z_offset, stop_time, z_buffer):
    #
    #    ### Go Through Machine Origin
    #
    #     export = []
    #
    #     ### print msg, print parameter
    #     export.append(self.define_print_msg())
    #     export.append(self.define_print_parameter(comp_info, f, m3_s, m4_s, z_offset, stop_time, z_buffer))
    #
    #     ### gcode start
    #     export.append(self.gcode_start())
    #
    #     ### head1 start
    #     export.append(self.head1_start())
    #
    #     ### gcode
    #     for i in xrange(len(points_list)):
    #
    #         pts = points_list[i]
    #         layer_info = "( ========= Layer : {} ========= )".format(i + 1)
    #
    #         ### Fisrt Layer
    #         if i == 0:
    #             export.append(self.points_to_gcode(layer_info, pts, m3_s_1st, m4_s, f_1st, stop_time, z_buffer))
    #
    #         ### Second - Last Layer
    #         else:
    #             export.append(self.points_to_gcode(layer_info, pts, m3_s, m4_s, f, stop_time, z_buffer))
    #
    #     ### gcode end
    #     export.append(self.gcode_end())
    #
    #     export_join = "".join(export)
    #
    #     return export_join


    def points_list_to_gcode_no_origin(self, points_list, comp_info, m7_tf, m3_s, m3_s_1st, m4_s, f, f_1st,  z_offset, stop_time, z_buffer):
        
        ### Not Go Through Machine Origin

        export = []

        ### print msg, print parameter
        export.append(self.define_print_msg())
        export.append(self.define_print_parameter(comp_info, f, m3_s, m4_s, z_offset, stop_time, z_buffer))

        ### gcode start
        export.append(self.gcode_start_no_origin())

        ### head1 start
        export.append(self.head1_start(m7_tf))

        ### gcode
        for i in xrange(len(points_list)):
            
            pts = points_list[i]
            layer_info = "( ========= Layer : {} ========= )".format(i + 1)
            
            ### Fisrt Layer
            if i == 0:
                export.append(self.points_to_gcode(layer_info, pts, m3_s_1st, m4_s, f_1st, stop_time, z_buffer))
            
            ### Second - Last Layer
            else:
                export.append(self.points_to_gcode(layer_info, pts, m3_s, m4_s, f, stop_time, z_buffer))
        
        ### gcode end
        export.append(self.gcode_end_no_origin())

        export_join = "".join(export)

        return export_join

op_bg = BigGcode()


##########

##########


ghenv.Component.Message = '(2) Points to gcode / 200912'


comp_info = "ver1_200912"
Z_OFFSET_VALUE = INFO
M4_S_VALUE = 0
M4_STOP_TIME = 0


### Points to Gcode
if RUN_AND_EXPORT:
    gcode = op_bg.points_list_to_gcode_no_origin(POINTS, comp_info, M7_ON, M3_S_VALUE, M3_S_VALUE_1st, M4_S_VALUE, F_VALUE, F_VALUE_1st, Z_OFFSET_VALUE, M4_STOP_TIME, Z_BUFFER)
    ut.export_gcode(EXPORT_DIR, gcode)
# ---------- end python_4 ----------

# ---- group: Draw Sequence
divide = DivideCurve(Curve=python_3.MOVE, Count=1000, Kinks=False)  # -> Points, Tangents, Parameters
item = ListItem(List=divide.Points, Index=Slider(0, range=0..1000), Wrap=True)
sph = Sphere(Base=item, Radius=20)

divide_2 = DivideCurve(Curve=python_2.MOVE, Count=1000, Kinks=False)  # -> Points, Tangents, Parameters
item_2 = ListItem(List=divide_2.Points, Index=Slider(470, range=0..1000), Wrap=True)
sph_2 = Sphere(Base=item_2, Radius=5)

# ---- group: Build Plate
swatch = ColourSwatch(SwatchColor=RGB(187, 255, 255))  # disabled
python_5 = GhPythonScript()  # -> out, AREA; disabled
# ---------- python_5: Python ----------
import rhinoscriptsyntax as rs

AREA = rs.AddRectangle(rs.WorldXYPlane(), 1700, 1300)
# ---------- end python_5 ----------
preview = CustomPreview(Geometry=python_5.AREA, Material=swatch)  # disabled

# ----
panel_22 = Panel(python_4.out)

# ---- group: Build Plate
swatch_2 = ColourSwatch(SwatchColor=RGB(187, 255, 255))  # disabled
python_6 = GhPythonScript()  # -> out, AREA; disabled; same code as python_5
preview_2 = CustomPreview(Geometry=python_6.AREA, Material=swatch_2)  # disabled
